% Simulink data dictionary NavigationDictionary.sldd

accelBus = Simulink.Bus()
  accel: double[3 1]
  timestamp: double
  validity: boolean

angvelBus = Simulink.Bus()
  angvel: double[3 1]
  timestamp: double
  validity: boolean

baroBus = Simulink.Bus()
  height: double
  timestamp: double
  validity: boolean

lidarBus = Simulink.Bus()
  distance: double
  timestamp: double
  validity: boolean

gpsBus = Simulink.Bus()
  pos: double[3 1]
  vel: double[3 1]
  timestamp: double
  validity: boolean

magBus = Simulink.Bus()
  bfield: double[3 1]
  timestamp: double
  validity: boolean